# Grasshopper definition ImageRegion+TreePlacement.gh (Grasshopper 0.9.76)
# plug-ins: Python Interpreter

image_step = Slider(45, range=30..100)
ladybug = Ladybug_Ladybug()  # -> Vviiiiiiiiiizzz; plug-in component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

boolean_toggle = BooleanToggle(True)
image_steps = Number(image_step)
path = FilePath("C:\Users\LJobson\Documents\GitHub\SolarSculptor\resources\testImage\GradientImg4Color.png")

# ----
# Active Brush
python_script = PythonScript(imagePath=path, run=boolean_toggle, step=image_steps)  # -> out, redData, greenData, blueData, alphaData, xSize, ySize; inputs run: Boolean, step: Int32
# ---------- python_script: Python ----------
import os
from System import Object
import Grasshopper.Kernel as gh
from Grasshopper import DataTree
from Grasshopper.Kernel.Data import GH_Path
from System.Drawing import Image

redDataTree = DataTree[Object]()
greenDataTree = DataTree[Object]()
blueDataTree = DataTree[Object]()
alphaDataTree = DataTree[Object]()
redData = []
greenData = []
blueData =[]
alphaData=[]

if run:
    img = Image.FromFile(imagePath)
    for indexY, y in enumerate(range(0, img.Height,step)):

        yPath = GH_Path(indexY)
        for indexX, x in enumerate(range(0,img.Width, step)):
            colorData = img.GetPixel(x, y)
            redDataTree.Add(colorData.R/255, yPath)
            greenDataTree.Add(colorData.G/255, yPath)
            blueDataTree.Add(colorData.B/255, yPath)
            alphaDataTree.Add(colorData.A/255, yPath)
img.Dispose()
redData, greenData, blueData, alphaData = [redDataTree, greenDataTree, blueDataTree, alphaDataTree]
xSize = indexX; ySize = indexY
# ---------- end python_script ----------
timer = Timer(TimerInterval=1000, Target=python_script)  # disabled

# ----
# Import EPW
panel = Panel("https://www.energyplus.net/weather-download/north_and_central_america_wmo_region_4/USA/NY/USA_NY_New.York-J.F.Kennedy.Intl.AP.744860_TMY3/all")

# ----
# Active Workspace
interest_spot_threshold = Slider(0.08, range=0..0.5)
height_multiplier = Slider(8, range=0..50)
cluster = Cluster(
    reddata=python_script.redData,
    greendata=python_script.greenData,
    bluedata=python_script.blueData,
    xsize=python_script.xSize,
    ysize=python_script.ySize,
    place_of_interest_threshold=interest_spot_threshold,
    height_multiplier=height_multiplier,
    landscape_size=Slider(100, range=100..300))  # -> points_on_topo_2, points_of_interest_2, areas_of_interest_2, topo_fragments_to_color_2, topo_colors_2, toposurface_2, nurbs_curves_2, working_surface_2

# ----
# Construct Sky Matrix
toggle = BooleanToggle(False)
cluster_2 = Cluster_2(weatherfileurl=panel, enable=toggle)  # -> skydome_mesh_2, skydome_points_2, radiation_values_2

points_of_interest = Point(cluster.points_on_topo_2)
points_of_interest_2 = Point(cluster.points_of_interest_2)
areas_of_interest = Curve(cluster.areas_of_interest_2)

# ----
# Represent POI
circle = CircleCNR(Center=cluster.points_on_topo_2, Normal=Vector(0, 0, 1), Radius=0.2)
preview = CustomPreview(Geometry=circle, Shader=ColourSwatch(SwatchColor=RGB(255, 255, 255)))

# ----
# Represent Topo
swatch = ColourSwatch(SwatchColor=RGB(123, 138, 121))
preview_2 = CustomPreview(Geometry=cluster.toposurface_2, Shader=swatch)

radiation_values = Number(cluster_2.radiation_values_2)
skydome_points = Point(cluster_2.skydome_points_2)
skydome_mesh = Mesh(cluster_2.skydome_mesh_2)  # disabled
radiation_values_2 = Number([7.17, 7.2, 7.33, 7.58, 8.06, 10.04, 14.77, 14.63, 15.81, 17.21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])
skydome_points_2 = Point([Point(0, 495.4531246, 51.97717016), Point(103.0104967, 484.6262866, 51.97717017), Point(201.5189421, 452.6189525, 51.97717104), Point(291.2200421, 400.8299978, 51.97716862), Point(368.193427, 331.5228504, 51.97717082), Point(429.0749937, 247.7265633, 51.97717062)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])
mesh = Mesh(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)

# ----
# Input from Image
working_surface = Surface(cluster.working_surface_2)
points_of_interest_3 = Point(points_of_interest)
working_region = Curve(<curve referenced from the Rhino model>)
toposurface = Surface(cluster.toposurface_2)

preview_3 = CustomPreview(Geometry=working_region, Shader=ColourSwatch(SwatchColor=RGB(207, 207, 207)))

# ----
# Shade Structure
considered_vectors = Slider(3, range=1..20)
shade_density = Slider(10, range=10..20)
height = Slider(18, range=3..20)
cluster_3 = Cluster_6(
    height=height,
    toposurface=toposurface,
    skydome_points=skydome_points_2,
    radiation_values=radiation_values_2,
    areas_of_interest=areas_of_interest,
    shade_density=shade_density,
    considered_vectors=considered_vectors)  # disabled

# ----
# Shade Structure
considered_vectors_2 = Slider(3, range=1..20)
shade_density_2 = Slider(10, range=10..20)
height_2 = Slider(18, range=3..20)
cluster_4 = Cluster_7(
    height=height_2,
    toposurface=toposurface,
    skydome_points=skydome_points_2,
    radiation_values=radiation_values_2,
    areas_of_interest=areas_of_interest,
    shade_density=shade_density_2,
    considered_vectors=considered_vectors_2)

# ----
# Solve for Positioning
number_slider = Slider(15, range=1..20)
cluster_5 = Cluster_5(
    tree_height=number_slider,
    points_of_interest=points_of_interest_3,
    working_surface=toposurface,
    skydome_points=skydome_points_2,
    radiation_values=radiation_values_2)  # -> height_2, points_within_reason_2; disabled

shade_structure = Geometry(cluster_3)
preview_4 = CustomPreview(Geometry=shade_structure, Shader=ColourSwatch(SwatchColor=RGB(214, 214, 214)))

# ----
# Visualize Vectors
radiation_values_3 = Number(radiation_values_2)
skydome_points_3 = Point(skydome_points_2)
vec2pt = Vector2Pt(PointA=skydome_points_3, PointB="0,0,0", Unitize=False)  # -> unitize(Vector), Length
bnd = Bounds(Numbers=radiation_values_3)
multiplication = Multiplication(A=vec2pt.Vector, B=radiation_values_3)
vdisex = VectorDisplayEx(Point=skydome_points_3, Vector=multiplication, Colour=ColourSwatch(SwatchColor=RGBA(219, 219, 219, 105)), Width=2)

# ----
# Apply Trees
number_slider_2 = Slider(13, range=0..20)
cluster_6 = Cluster_4(
    tree_height=cluster_5.height_2,
    possible_trees_within_reason=cluster_5.points_within_reason_2,
    trees_per_patch=number_slider_2)

# ----
# Generate Rep
cluster_7 = Cluster_3(trees_as_crvs=cluster_6)  # -> tree_objects_2, stick_2

# ----
# Visualize By Efficiency
tree_objects = Geometry(cluster_7.tree_objects_2)
lng = ListLength(List=tree_objects)
range = Range(Domain=Domain(0, 1), Steps=expr("x-1", lng))
gradient = Gradient(
    LowerLimit=0,
    UpperLimit=1,
    Parameter=range,
    stops=[0: RGB(234, 38, 0), 0.25: RGB(234, 126, 0), 0.5: RGB(254, 244, 84), 0.75: RGB(173, 203, 249), 1: RGB(75, 107, 169)])
preview_5 = CustomPreview(Geometry=tree_objects, Shader=gradient)

# ==== cluster Cluster
place_of_interest_threshold = ClusterInput()
height_multiplier = ClusterInput()
greendata = ClusterInput()
bluedata = ClusterInput()
reddata = ClusterInput()
ysize = ClusterInput()
xsize = ClusterInput()

place_of_interest_threshold_2 = Number(place_of_interest_threshold)
height_multiplier_2 = Number(height_multiplier)
greendata_2 = Number(greendata)
bluedata_2 = Number(bluedata)
reddata_2 = Number(reddata)
ysize_2 = Number(ysize)
xsize_2 = Number(xsize)

greendata_3 = Number(greendata_2)

# ----
# Landscape from Colors
square = Square(Plane=PlaneXY(0, 0, 0), Size=1, ExtentX=xsize_2, ExtentY=ysize_2)  # -> Cells, Points
deconstruct = Deconstruct(Point=square.Points)  # -> simplify(XComponent), simplify(YComponent), ZComponent
multiplication = Multiplication(A=bluedata_2, B=height_multiplier_2)
construct_point = ConstructPoint(XCoordinate=deconstruct.XComponent, YCoordinate=deconstruct.YComponent, ZCoordinate=multiplication)
interpolate = Interpolate(Vertices=construct_point, Degree=3, Periodic=False, KnotStyle=1)  # -> Curve, Length, Domain
loft = Loft(
    Curves=flatten(interpolate.Curve),
    Options={Adjust=False, Closed=False, LoftEnds=0, LoftSimp=0, LoftType=0, Rebuild=10, Refit=0.01})  # disabled

number_slider = Slider(9, range=0..20)
bbox = BoundingBox(Content=flatten(interpolate.Curve), Plane=PlaneXY(0, 0, 0), UnionBox=True)  # -> Box, Box_2
landscape_size = ClusterInput()
debox = DeconstructBox(Box=bbox.Box)  # -> Plane, X, Y, Z
landscape_size_2 = Number(landscape_size)

# ----
# Color Topo Fragments
mesh = MeshBrep(
    Brep=loft,
    Settings={GridMaxCount=0, GridMinCount=16, JaggedSeams=False, MaxEdgeLength=0, MinEdgeLength=0.0001, MinTolerance=0, Refine=True, RefineAngle=0, RelativeTolerance=0.65, SimplePlanes=True, Tolerance=0})
explode = MeshExplode(Mesh=mesh, Interpolate=False)
demesh = DeconstructMesh(Mesh=explode)  # -> Vertices, Faces, Colours, Normals
item = ListItem(List=demesh.Vertices, Index=0, Wrap=True)
pdecon = Deconstruct(Point=item)  # -> XComponent, YComponent, ZComponent
bnd = Bounds(Numbers=flatten(pdecon.ZComponent))
remap = RemapNumbers(Value=pdecon.ZComponent, Source=bnd, Target=Domain(0, 1))  # -> Mapped, Clipped
gradient = Gradient(
    LowerLimit=0,
    UpperLimit=1,
    Parameter=remap.Mapped,
    stops=[0: RGB(0, 97, 68), 0.25: RGB(81, 175, 17), 0.5: RGB(159, 198, 146), 0.75: RGB(170, 235, 41), 1: RGB(221, 255, 53)])

dedomain = DeconstructDomain(Domain=debox.X)  # -> Start, End
dedomain_2 = DeconstructDomain(Domain=debox.Y)  # -> Start, expr("-x/2", End)
dedomain_3 = DeconstructDomain(Domain=debox.X)  # -> Start, expr("-x/2", End)
division = Division(A=landscape_size_2, B=dedomain.End)
jagged = SettingsSpeed()
Z = UnitZ(Factor=1)
X = UnitX(Factor=dedomain_3.End)
Y = UnitY(Factor=dedomain_2.End)
move = Move(Geometry=interpolate.Curve, Motion=X)  # -> Geometry, Transform
move_2 = Move(Geometry=move.Geometry, Motion=Y)  # -> Geometry, Transform
scale = Scale(Geometry=move_2.Geometry, Center=Point(0, 0, 0), Factor=division)  # -> Geometry, Transform
loft_2 = Loft(
    Curves=flatten(scale.Geometry),
    Options={Adjust=False, Closed=False, LoftEnds=0, LoftSimp=0, LoftType=0, Rebuild=10, Refit=0.01})
mesh_2 = MeshBrep(Brep=loft_2, Settings=jagged)
bbox_2 = BoundingBox(Content=flatten(scale.Geometry), Plane=PlaneXY(0, 0, 0), UnionBox=True)  # -> Box, Box_2
debrep = DeconstructBrep(Brep=bbox_2.Box)  # -> Faces, Edges, Vertices
item_2 = ListItem(List=debrep.Faces, Index=4, Wrap=True)

# ----
# Select Mesh
mplane = MeshPlane(Boundary=item_2, WidthCount=ysize_2, HeightCount=ysize_2)  # -> Mesh, Area
flip = FlipMatrix(Data=reddata_2)
meshselector = Ladybug_MeshThresholdSelector(inputMesh=mplane.Mesh, analysisResult=flatten(flip), operator=">", levelOfPerform=place_of_interest_threshold_2)  # -> readMe, totalValue, areaMeetsThresh, newColoredMesh, newMeshOutline; plug-in component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
demesh_2 = DeconstructMesh(Mesh=meshselector.newColoredMesh)  # -> Vertices, Faces, Colours, Normals

srf = Surface(meshselector.newMeshOutline)
mesh_3 = Mesh(graft(meshselector.newMeshOutline))
sdivide = DivideSurface(Surface=srf, UCount=number_slider, VCount=number_slider)  # -> Points, Normals, Parameters
pshift = ShiftPaths(Data=sdivide.Points, Offset=-1)
clean = CleanTree(RemoveNulls=True, RemoveInvalid=True, RemoveEmpty=False, Tree=pshift)
meshray = MeshRay(Mesh=mesh_2, Point=clean, Direction=Z)  # -> Point, Hit

topo_fragments_to_color = Geometry(explode)
points_on_topo = Point(meshray.Point)
points_of_interest = Point(demesh_2.Vertices)
areas_of_interest = Curve(meshselector.newMeshOutline)
working_surface = Surface(item_2)
topo_colors = Data(gradient)
toposurface = Surface(loft_2)
nurbs_curves = Curve(scale.Geometry)

topo_colors_2 = ClusterOutput(topo_colors)
toposurface_2 = ClusterOutput(toposurface)
areas_of_interest_2 = ClusterOutput(areas_of_interest)
points_of_interest_2 = ClusterOutput(points_of_interest)
points_on_topo_2 = ClusterOutput(points_on_topo)
nurbs_curves_2 = ClusterOutput(nurbs_curves)
working_surface_2 = ClusterOutput(working_surface)
topo_fragments_to_color_2 = ClusterOutput(topo_fragments_to_color)

# ==== cluster Cluster_2
weatherfileurl = ClusterInput()
enable = ClusterInput()
enable_2 = Boolean(enable)

# ----
# Construct Sky Matrix
epw_stat = Ladybug_OpenEPWAndSTATWeatherFiles(weatherFileURL=weatherfileurl)  # -> epwFile, statFile; plug-in component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
gencumulativeskymtx = Ladybug_GenCumulativeSkyMtx(epwFile=epw_stat.epwFile, skyDensity=0, useOldRes=True, runIt=enable_2)  # -> readMe, cumulativeSkyMtx; plug-in component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
analysisperiod = Ladybug_AnalysisPeriod()  # -> readMe, analysisPeriod; plug-in component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
selectskymtx = Ladybug_selectSkyMtx(
    cumulativeSkyMtx=gencumulativeskymtx.cumulativeSkyMtx,
    analysisPeriod=analysisperiod.analysisPeriod,
    removeDiffuse=False,
    removeDirect=False)  # -> readMe, selectedSkyMtx; plug-in component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
skydome = Ladybug_SkyDome(selectedSkyMtx=selectskymtx.selectedSkyMtx, showTotalOnly=False, bakeIt="2", runIt=Toggle(True))  # -> readMe, skyPatchesMesh, baseCrvs, altitudeCrvs, legend, legendBasePts, skyPatchesCenPts, skyPatchesAreas, skyPatchesAsBrep, values; plug-in component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
flip = FlipMatrix(Data=skydome.values)
flip_2 = FlipMatrix(Data=skydome.skyPatchesCenPts)
item = ListItem(List=flatten(skydome.skyPatchesMesh), Index=0, Wrap=True)
item_2 = ListItem(List=flip, Index=0, Wrap=True)
item_3 = ListItem(List=flip_2, Index=0, Wrap=True)
flip_3 = FlipMatrix(Data=item_3)
flip_4 = FlipMatrix(Data=item_2)
skydome_mesh = Mesh(item)  # disabled
radiation_values = Number(flip_4)
skydome_points = Point(flip_3)

skydome_mesh_2 = ClusterOutput(skydome_mesh)
radiation_values_2 = ClusterOutput(radiation_values)
skydome_points_2 = ClusterOutput(skydome_points)

# ==== cluster Cluster_3
trees_as_crvs = ClusterInput()
trees_as_crvs_2 = Curve(reparameterize(trees_as_crvs))
end = EndPoints(Curve=trees_as_crvs_2)  # -> Start, End
eval = EvaluateCurve(Curve=trees_as_crvs_2, Parameter=0.25)  # -> Point, Tangent, Angle
pipe = Pipe(Curve=trees_as_crvs_2, Radius=Slider(0.25, range=0..1), Caps=0)
ln = Line(StartPoint=end.End, EndPoint=eval.Point)
dist = Distance(PointA=end.End, PointB=eval.Point)
eval_2 = EvaluateCurve(Curve=reparameterize(ln), Parameter=0.5)  # -> Point, Tangent, Angle
pshift = ShiftPaths(Data=pipe, Offset=-1)
Y = UnitY(Factor=1)
X = UnitX(Factor=1)
jagged = SettingsSpeed()
circle = CircleCNR(Center=eval_2.Point, Normal=X, Radius=expr("x/2", dist))
circle_2 = CircleCNR(Center=eval_2.Point, Normal=Y, Radius=expr("x/2", dist))
mesh = MeshBrep(Brep=graft(pshift), Settings=jagged)
mesh_2 = MeshBrep(Brep=graft(circle), Settings=jagged)
mesh_3 = MeshBrep(Brep=graft(circle_2), Settings=jagged)
mesh_4 = Mesh(pshift)
stick = Geometry(pshift)
mjoin = MeshJoin(Meshes=[mesh_3, mesh_2, mesh])
stick_2 = ClusterOutput(stick)
pshift_2 = ShiftPaths(Data=mjoin, Offset=-1)
tree_objects = Geometry(pshift_2)
tree_objects_2 = ClusterOutput(tree_objects)

# ==== cluster Cluster_4
possible_trees_within_reason = ClusterInput()
trees_per_patch = ClusterInput()
tree_height = ClusterInput()
possible_trees_within_reason_2 = Point(possible_trees_within_reason)
trees_per_patch_2 = Number(trees_per_patch)
tree_height_2 = Number(tree_height)
range = Range(Domain=Domain(0, 1), Steps=trees_per_patch_2)
graph = GraphMapper(
    range,
    x0=0,
    x1=1,
    y0=0,
    y1=1,
    container_name="Bezier",
    cpx=[0, 0.7185270786, 0.8584090471, 1],
    cpy=[0, 0.2889970541, 0.4938248396, 1])
lng = ListLength(List=possible_trees_within_reason_2)
Z = UnitZ(Factor=1)
dom = ConstructDomain(DomainStart=0, DomainEnd=lng)
line = LineSDL(Start=possible_trees_within_reason_2, Direction=Z, Length=tree_height_2)  # -> simplify(Line)
remap = RemapNumbers(Value=graph, Source=Domain(0, 1), Target=dom)  # -> Mapped, Clipped
item = ListItem(List=line, Index=remap.Mapped, Wrap=True)
trees_as_crvs = Curve(item)
trees_as_crvs_2 = ClusterOutput(trees_as_crvs)

# ==== cluster Cluster_5
points_of_interest = ClusterInput()
radiation_values = ClusterInput()
working_surface = ClusterInput()
skydome_points = ClusterInput()
tree_height = ClusterInput()

points_of_interest_2 = Point(simplify(points_of_interest))
working_surface_2 = Surface(working_surface)
radiation_values_2 = Number(radiation_values)
skydome_points_2 = Point(skydome_points)
tree_height_2 = Number(tree_height)

jitter = Jitter(List=points_of_interest_2, Jitter=1, Seed=2)  # -> Values, Indices
cull = CullPattern(List=jitter.Values, CullPattern=[True, False, False])
item = ListItem(List=cull, Index=5, Wrap=True)  # -> simplify(graft(Item))
Z = UnitZ(Factor=-1)

# ----
# Solve for Positioning
panel = Panel("0,0,0")
vec2pt = Vector2Pt(PointA=skydome_points_2, PointB=panel, Unitize=False)  # -> unitize(Vector), Length
radiation_values_3 = Number(radiation_values_2)
skydome_vectors = Vector(vec2pt.Vector)
sort = SortList(Keys=radiation_values_3, ValuesA=skydome_vectors)  # -> reverse(Keys), reverse(ValuesA)
Z_2 = UnitZ(Factor=tree_height_2)
skydome_vectors_sorted = Vector(sort.ValuesA)
radiation_values_sorted = Number(sort.Keys)
move = Move(Geometry=working_surface_2, Motion=Z_2)  # -> Geometry, Transform
series = Series(Start=0, Step=1, Count=10)
testpoint = Point(item)
scale = Scale(Geometry=move.Geometry, Center=Point(0, 0, 0), Factor="2.0")  # -> Geometry, Transform
item_2 = ListItem(List=skydome_vectors_sorted, Index=series, Wrap=True)
neg = Negative(Value=item_2)
treeline = Surface(scale.Geometry)
line = LineSDL(Start=testpoint, Direction=neg, Length=50)
group = Group(Objects=cull)
working_surface_3 = Surface(working_surface_2)
Z_3 = UnitZ(Factor=1)

meshray = MeshRay(Mesh=treeline, Point=testpoint, Direction=neg)  # -> Point, Hit

vec2pt_2 = Vector2Pt(PointA=testpoint, PointB=meshray.Point, Unitize=False)  # -> Vector, Length
move_2 = Move(Geometry=group, Motion=vec2pt_2.Vector)  # -> Geometry, Transform
ungroup = Ungroup(Group=move_2.Geometry)
pshift = ShiftPaths(Data=ungroup, Offset=-1)
line_2 = LineSDL(Start=ungroup, Direction=Z_3, Length=1)
lng = ListLength(List=pshift)

pdecon = Deconstruct(Point=ungroup)  # -> XComponent, YComponent, ZComponent
pt = ConstructPoint(XCoordinate=pdecon.XComponent, YCoordinate=pdecon.YComponent, ZCoordinate=100)
meshray_2 = MeshRay(Mesh=working_surface_3, Point=pt, Direction=Z)  # -> Point, Hit

clean = CleanTree(RemoveNulls=True, RemoveInvalid=True, RemoveEmpty=False, Tree=meshray_2.Point)
pshift_2 = ShiftPaths(Data=simplify(clean), Offset=-1)

points_within_reason = Data(pshift_2)
height = Data(tree_height_2)

points_within_reason_2 = ClusterOutput(points_within_reason)
height_2 = ClusterOutput(height)

# ==== cluster Cluster_6
toposurface = ClusterInput()
skydome_points = ClusterInput()
radiation_values = ClusterInput()
areas_of_interest = ClusterInput()
height = ClusterInput()
considered_vectors = ClusterInput()
shade_density = ClusterInput()
radiation_values_2 = Number(radiation_values)
skydome_points_2 = Point(skydome_points)
areas_of_interest_2 = Curve(areas_of_interest)
considered_vectors_2 = Number(considered_vectors)
shade_density_2 = Number(shade_density)
toposurface_2 = Surface(toposurface)
height_2 = Number(height)
cp = ControlPoints(Curve=areas_of_interest_2)  # -> Points, Weights, Knots
jagged = SettingsSpeed()
mesh = MeshBrep(Brep=toposurface_2, Settings=jagged)
Z = UnitZ(Factor=1)
vec2pt = Vector2Pt(PointA=skydome_points_2, PointB="0,0,0", Unitize=False)  # -> Vector, Length
bbox = BoundingBox(Content=mesh, Plane=PlaneXY(0, 0, 0))  # -> Box, Box_2
meshray = MeshRay(Mesh=mesh, Point=cp.Points, Direction=Z)  # -> Point, Hit
neg = Negative(Value=vec2pt.Vector)
debrep = DeconstructBrep(Brep=bbox.Box)  # -> Faces, Edges, Vertices
pt = Point(graft(meshray.Point))
sort = SortList(Keys=radiation_values_2, ValuesA=neg)  # -> Keys, reverse(ValuesA)
series = Series(Start=0, Step=1, Count=considered_vectors_2)
Z_2 = UnitZ(Factor=height_2)
item = ListItem(List=debrep.Faces, Index=4, Wrap=True)
item_2 = ListItem(List=sort.ValuesA, Index=series, Wrap=True)
move = Move(Geometry=item, Motion=Z_2)  # -> Geometry, Transform
mesh_2 = Mesh(move.Geometry)
meshray_2 = MeshRay(Mesh=mesh_2, Point=pt, Direction=item_2)  # -> Point, Hit
pshift = ShiftPaths(Data=meshray_2.Point, Offset=-1)
bbox_2 = BoundingBox(Content=pshift, Plane=PlaneXY(0, 0, 0), UnionBox=True)  # -> Box, Box_2
debrep_2 = DeconstructBrep(Brep=bbox_2.Box)  # -> Faces, Edges, Vertices
item_3 = ListItem(List=debrep_2.Faces, Index=4, Wrap=True)
dim = Dimensions(Surface=item_3)  # -> UDimension, VDimension
sdivide = DivideSurface(Surface=item_3, UCount=shade_density_2, VCount=shade_density_2)  # -> Points, Normals, Parameters
division = Division(A=dim.VDimension, B=shade_density_2)
pline = PolyLine(Vertices=sdivide.Points, Closed=False)
Z_3 = UnitZ(Factor=division)
extr = Extrude(Base=pline, Direction=Z_3)
shade_structure = Geometry(extr)
shade_structure_2 = ClusterOutput(shade_structure)

# ==== cluster Cluster_7
radiation_values = ClusterInput()
skydome_points = ClusterInput()
areas_of_interest = ClusterInput()
considered_vectors = ClusterInput()
shade_density = ClusterInput()
toposurface = ClusterInput()
height = ClusterInput()
radiation_values_2 = Number(radiation_values)
skydome_points_2 = Point(skydome_points)
areas_of_interest_2 = Curve(areas_of_interest)
considered_vectors_2 = Number(considered_vectors)
shade_density_2 = Number(shade_density)
toposurface_2 = Surface(toposurface)
height_2 = Number(height)
cp = ControlPoints(Curve=areas_of_interest_2)  # -> Points, Weights, Knots
jagged = SettingsSpeed()
mesh = MeshBrep(Brep=toposurface_2, Settings=jagged)
Z = UnitZ(Factor=1)
vec2pt = Vector2Pt(PointA=skydome_points_2, PointB="0,0,0", Unitize=False)  # -> Vector, Length
bbox = BoundingBox(Content=mesh, Plane=PlaneXY(0, 0, 0))  # -> Box, Box_2
meshray = MeshRay(Mesh=mesh, Point=cp.Points, Direction=Z)  # -> Point, Hit
neg = Negative(Value=vec2pt.Vector)
debrep = DeconstructBrep(Brep=bbox.Box)  # -> Faces, Edges, Vertices
pt = Point(graft(meshray.Point))
sort = SortList(Keys=radiation_values_2, ValuesA=neg)  # -> Keys, reverse(ValuesA)
series = Series(Start=0, Step=1, Count=considered_vectors_2)
Z_2 = UnitZ(Factor=height_2)
item = ListItem(List=debrep.Faces, Index=4, Wrap=True)
item_2 = ListItem(List=sort.ValuesA, Index=series, Wrap=True)
move = Move(Geometry=item, Motion=Z_2)  # -> Geometry, Transform
mesh_2 = Mesh(move.Geometry)
meshray_2 = MeshRay(Mesh=mesh_2, Point=pt, Direction=item_2)  # -> Point, Hit
pshift = ShiftPaths(Data=meshray_2.Point, Offset=-1)
bbox_2 = BoundingBox(Content=pshift, Plane=PlaneXY(0, 0, 0), UnionBox=True)  # -> Box, Box_2
debrep_2 = DeconstructBrep(Brep=bbox_2.Box)  # -> Faces, Edges, Vertices
item_3 = ListItem(List=debrep_2.Faces, Index=4, Wrap=True)
dim = Dimensions(Surface=item_3)  # -> UDimension, VDimension
sdivide = DivideSurface(Surface=item_3, UCount=shade_density_2, VCount=shade_density_2)  # -> Points, Normals, Parameters
division = Division(A=dim.VDimension, B=shade_density_2)
pline = PolyLine(Vertices=sdivide.Points, Closed=False)
Z_3 = UnitZ(Factor=division)
extr = Extrude(Base=pline, Direction=Z_3)
shade_structure = Geometry(extr)
shade_structure_2 = ClusterOutput(shade_structure)
