# Grasshopper definition Tree_Placement_+UI.gh (Grasshopper 0.9.76)
# plug-ins: Python Interpreter

# ----
# Import EPW
panel = Panel("https://www.energyplus.net/weather-download/north_and_central_america_wmo_region_4/USA/NY/USA_NY_New.York-J.F.Kennedy.Intl.AP.744860_TMY3/all")

# ----
# Construct Sky Matrix
epw_stat = Ladybug_OpenEPWAndSTATWeatherFiles(weatherFileURL=panel)  # -> epwFile, statFile; plug-in component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
gencumulativeskymtx = Ladybug_GenCumulativeSkyMtx(epwFile=epw_stat.epwFile, skyDensity=0, useOldRes=True, runIt=Toggle(False))  # -> readMe, cumulativeSkyMtx; plug-in component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
analysisperiod = Ladybug_AnalysisPeriod()  # -> readMe, analysisPeriod; plug-in component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
selectskymtx = Ladybug_selectSkyMtx(
    cumulativeSkyMtx=gencumulativeskymtx.cumulativeSkyMtx,
    analysisPeriod=analysisperiod.analysisPeriod,
    removeDiffuse=False,
    removeDirect=False)  # -> readMe, selectedSkyMtx; plug-in component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
skydome = Ladybug_SkyDome(selectedSkyMtx=selectskymtx.selectedSkyMtx, showTotalOnly=False, bakeIt="2", runIt=Toggle(True))  # -> readMe, skyPatchesMesh, baseCrvs, altitudeCrvs, legend, legendBasePts, skyPatchesCenPts, skyPatchesAreas, skyPatchesAsBrep, values; plug-in component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
flip = FlipMatrix(Data=skydome.values)
flip_2 = FlipMatrix(Data=skydome.skyPatchesCenPts)
item = ListItem(List=flatten(skydome.skyPatchesMesh), Index=0, Wrap=True)
item_2 = ListItem(List=flip, Index=0, Wrap=True)
item_3 = ListItem(List=flip_2, Index=0, Wrap=True)
mesh = Mesh(item)  # disabled
flip_3 = FlipMatrix(Data=item_3)
flip_4 = FlipMatrix(Data=item_2)
mesh_2 = Mesh(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)

# ----
# OUT
# pts & values
radiation_values = Number([7.17, 7.2, 7.33, 7.58, 8.06, 10.04, 14.77, 14.63, 15.81, 17.21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])
skydome_points = Point([Point(0, 99.09062492, 10.39543403), Point(20.60209935, 96.92525732, 10.39543403), Point(40.30378841, 90.5237905, 10.39543421), Point(58.24400842, 80.16599955, 10.39543372), Point(73.6386854, 66.30457009, 10.39543416), Point(85.81499874, 49.54531265, 10.39543412)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])

# ----
# Input from Image
regions_to_shade = Curve([<curve referenced from the Rhino model> x2])
working_region = Curve(<curve referenced from the Rhino model>)

radiation_values_2 = Number(radiation_values)

# ----
# Visualize Vectors
radiation_values_3 = Number(radiation_values)
skydome_points_2 = Point(skydome_points)
vec2pt = Vector2Pt(PointA=skydome_points_2, PointB="0,0,0", Unitize=False)  # -> unitize(Vector), Length
bnd = Bounds(Numbers=radiation_values_3)
multiplication = Multiplication(A=vec2pt.Vector, B=radiation_values_3)
vdisex = VectorDisplayEx(Point=skydome_points_2, Vector=multiplication, Colour=ColourSwatch(SwatchColor=RGBA(219, 219, 219, 105)), Width=2)

skydome_points_3 = Point(skydome_points)

preview = CustomPreview(Geometry=working_region, Shader=ColourSwatch(SwatchColor=RGB(207, 207, 207)))

vec2pt_2 = Vector2Pt(PointA=skydome_points_3, PointB="0,0,0", Unitize=False)  # -> unitize(Vector), Length
regions_to_shade_2 = Curve(regions_to_shade)
number_slider = Slider(4, range=4..10)
skydome_vectors = Vector(vec2pt_2.Vector)
radiation_values_4 = Number(radiation_values_2)
working_surface = Surface(working_region)
tree_height = Number(Slider(13, range=1..20))
srf = Surface(regions_to_shade_2)
sort = SortList(Keys=radiation_values_4, ValuesA=skydome_vectors)  # -> reverse(Keys), reverse(ValuesA)
area = Area(Geometry=regions_to_shade_2)  # -> Area, graft(Centroid)
Z = UnitZ(Factor=tree_height)
sdivide = DivideSurface(Surface=srf, UCount=number_slider, VCount=number_slider)  # -> Points, Normals, Parameters
skydome_vectors_sorted = Vector(sort.ValuesA)
radiation_values_sorted = Number(sort.Keys)
move = Move(Geometry=working_surface, Motion=Z)  # -> Geometry, Transform
series = Series(Start=0, Step=1, Count=10)
clean = CleanTree(RemoveNulls=True, RemoveInvalid=True, RemoveEmpty=False, Tree=sdivide.Points)
pshift = ShiftPaths(Data=clean, Offset=-1)
scale = Scale(Geometry=move.Geometry, Center=Point(0, 0, 0), Factor="2.0")  # -> Geometry, Transform
item_4 = ListItem(List=skydome_vectors_sorted, Index=series, Wrap=True)
neg = Negative(Value=item_4)
multiplication_2 = Multiplication(A=neg, B=Slider(27, range=1..100))
vdis = VectorDisplay(Anchor=area.Centroid, Vector=multiplication_2)
treeline = Surface(scale.Geometry)
line = LineSDL(Start=area.Centroid, Direction=neg, Length=1)
group = Group(Objects=pshift)
slx = SurfaceLine(Surface=treeline, Line=line, LimitToFirst=False)  # -> Curves, Points, UVPoints, Normal
pshift_2 = ShiftPaths(Data=slx.Points, Offset=-1)
vec2pt_3 = Vector2Pt(PointA=area.Centroid, PointB=pshift_2, Unitize=False)  # -> Vector, Length
move_2 = Move(Geometry=group, Motion=vec2pt_3.Vector)  # -> Geometry, Transform
working_surface_2 = Surface(working_surface)
ungroup = Ungroup(Group=move_2.Geometry)
Z_2 = UnitZ(Factor=1)
pshift_3 = ShiftPaths(Data=ungroup, Offset=-1)
line_2 = LineSDL(Start=ungroup, Direction=Z_2, Length=1)
range = Range(Domain=Domain(0, 1), Steps=Slider(14, range=0..20))
lng = ListLength(List=pshift_3)
slx_2 = SurfaceLine(Surface=working_surface_2, Line=line_2, LimitToFirst=False)  # -> Curves, Points, UVPoints, Normal
pshift_4 = ShiftPaths(Data=simplify(slx_2.Points), Offset=-1)
graph = GraphMapper(range, x0=0, x1=1, y0=0, y1=1, container_name="Bezier", cpx=[0, 0.6036306024, 1, 1], cpy=[0, 0.005235731602, 0, 1])
dom = ConstructDomain(DomainStart=0, DomainEnd=lng)
remap = RemapNumbers(Value=graph, Source=Domain(0, 1), Target=dom)  # -> Mapped, Clipped
tree_height_2 = Number(tree_height)
pt = Point(pshift_4)
panel_2 = Panel(remap.Mapped)
Z_3 = UnitZ(Factor=1)
line_3 = LineSDL(Start=pt, Direction=Z_3, Length=tree_height_2)  # -> simplify(Line)
pshift_5 = ShiftPaths(Data=line_3, Offset=-1)
item_5 = ListItem(List=pshift_5, Index=remap.Mapped, Wrap=True)
pipe = Pipe(Curve=item_5, Radius=Slider(0.25, range=0..1), Caps=0)
pshift_6 = ShiftPaths(Data=pipe, Offset=-1)
tree_objects = Geometry(pshift_6)
tree_objects_2 = Geometry(tree_objects)

lng_2 = ListLength(List=tree_objects_2)
range_2 = Range(Domain=Domain(0, 1), Steps=expr("x-1", lng_2))
gradient = Gradient(
    LowerLimit=0,
    UpperLimit=1,
    Parameter=range_2,
    stops=[0: RGB(234, 38, 0), 0.25: RGB(234, 126, 0), 0.5: RGB(254, 244, 84), 0.75: RGB(173, 203, 249), 1: RGB(75, 107, 169)])
preview_2 = CustomPreview(Geometry=tree_objects_2, Shader=gradient)
