# Grasshopper definition LANDSAT_Thermal_Image_Importer.gh (Grasshopper 0.9.76)
# plug-ins: Python Interpreter

panel = Panel("D:\users\sgaray\Documents\GitHub\SolarSculptor\resources\testImage\GradientImg.png")
python_script = PythonScript(imagePath=panel, run=Toggle(True), step=Slider(100, range=0..100))  # -> out, redData, greenData, blueData, alphaData, xSize, ySize; inputs run: Boolean, step: Int32
# ---------- python_script: Python ----------
import os
from System import Object
import Grasshopper.Kernel as gh
from Grasshopper import DataTree
from Grasshopper.Kernel.Data import GH_Path
from System.Drawing import Image

redDataTree = DataTree[Object]()
greenDataTree = DataTree[Object]()
blueDataTree = DataTree[Object]()
alphaDataTree = DataTree[Object]()
redData = []
greenData = []
blueData =[]
alphaData=[]

if run:
    img = Image.FromFile(imagePath)
    for indexY, y in enumerate(range(0, img.Height,step)):

        yPath = GH_Path(indexY)
        for indexX, x in enumerate(range(0,img.Width, step)):
            colorData = img.GetPixel(x, y)
            redDataTree.Add(colorData.R/255, yPath)
            greenDataTree.Add(colorData.G/255, yPath)
            blueDataTree.Add(colorData.B/255, yPath)
            alphaDataTree.Add(colorData.A/255, yPath)
img.Dispose
redData, greenData, blueData, alphaData = [redDataTree, greenDataTree, blueDataTree, alphaDataTree]
xSize = indexX; ySize = indexY
# ---------- end python_script ----------
square = Square(Plane=PlaneXY(0, 0, 0), Size=1, ExtentX=python_script.xSize, ExtentY=python_script.ySize)  # -> Cells, Points
deconstruct = Deconstruct(Point=square.Points)  # -> simplify(XComponent), simplify(YComponent), ZComponent
# Import Image
multiplication = Multiplication(A=python_script.redData, B=Slider(1, range=1..50))
construct_point = ConstructPoint(XCoordinate=deconstruct.XComponent, YCoordinate=deconstruct.YComponent, ZCoordinate=multiplication)
panel_2 = Panel(python_script.alphaData)
panel_3 = Panel(python_script.redData)
interpolate = Interpolate(Vertices=construct_point, Degree=3, Periodic=False, KnotStyle=1)  # -> Curve, Length, Domain
loft = Loft(
    Curves=flatten(interpolate.Curve),
    Options={Adjust=False, Closed=False, LoftEnds=0, LoftSimp=0, LoftType=0, Rebuild=10, Refit=0.01})
panel_4 = Panel(python_script.greenData)
panel_5 = Panel(python_script.blueData)
